# Grasshopper definition dev_mesh_contour.ghx (Grasshopper 1.0.7)

python = GhPythonScript()  # -> out, POINT_OUT, LINE_OUT, MESH_OUT
# ---------- python: Python ----------
vert_0 = [3, 2, 1]
vert_1 = [3, 10, 4]
vert_2 = [5, 6, 10]
vert_3 = [11, 0, 2]

########################################

#points = [vert_0]
#points = [vert_0, vert_1]
#points = [vert_0, vert_1, vert_2]
points = [vert_0, vert_1, vert_2, vert_3]


########################################

line_0 = [vert_0, vert_1]
line_1 = [vert_1, vert_2]
line_2 = [vert_2, vert_3]

#lines = [line_0]
#lines = [line_0, line_1]
lines = [line_0, line_1, line_2]

########################################

mesh_0 = [vert_0, vert_2, vert_1]
mesh_1 = [vert_0, vert_3, vert_2]
mesh_2 = [vert_0, vert_1, vert_3]
mesh_3 = [vert_1, vert_2, vert_3]


#meshes = [mesh_0]
#meshes = [mesh_0, mesh_1]
#meshes = [mesh_0, mesh_1, mesh_2]
meshes = [mesh_0, mesh_1, mesh_2, mesh_3]

########################################

POINT_OUT = points
LINE_OUT = lines
MESH_OUT = meshes
# ---------- end python ----------
# Dev Mesh Contour
toggle = BooleanToggle(False)
python_2 = GhPythonScript(
    PATH_0="C:\Users\yoshioca\Documents\Mesh_Contour",
    PATH_1="C:\Users\yoshioca\Documents\Mesh_Contour\GH_Renderer",
    BOOL=toggle)  # -> out
# ---------- python_2: Python ----------
import sys

if BOOL:
    sys.path.append(PATH_0)
    sys.path.append(PATH_1)
    sys.path.append(PATH_2)
    sys.path.append(PATH_3)

print(sys.path)
# ---------- end python_2 ----------
python_3 = GhPythonScript(HEIGHT=Slider(14.5, range=0..30))  # -> out, a, b, c
# ---------- python_3: Python ----------
from mesh_contour import run_mesh_contour
from mesh_contour import line_plane_intersection

reload(line_plane_intersection)
reload(run_mesh_contour)

lp = line_plane_intersection.LinePlaneIntersection()
mc = run_mesh_contour.RunMeshContour()


#####

ghenv.Component.Message = 'RUN'


p = "C:\\Users\\yoshioca\\Documents\\Mesh_Contour\\_stl_\\bunny-flatfoot_fixed_light.stl"
h = HEIGHT


meshes, ranges = mc.set_mesh(p)
meshes_filtered, lines = mc.run_contour(meshes, ranges, h)


#print(len(meshes_filtered))

a = meshes
b = meshes_filtered
c = lines
# ---------- end python_3 ----------
python_4 = GhPythonScript(POINT_IN=python.POINT_OUT)  # -> POINT_RENDERED, LINE_RENDERED, MESH_RENDERED; inputs POINT_IN: list, LINE_IN: list, MESH_IN: list
# ---------- python_4: Python ----------
from gh_renderer import renderer
reload(renderer)
rr = renderer.Renderer()


########################################


ghenv.Component.Message = 'RENDERER'

point_in = POINT_IN
line_in = LINE_IN
mesh_in = MESH_IN

point_rendered = rr.render_points(point_in)
line_rendered = rr.render_lines(line_in)
mesh_rendered = rr.render_meshes(mesh_in)

POINT_RENDERED = point_rendered
LINE_RENDERED = line_rendered
MESH_RENDERED = mesh_rendered
# ---------- end python_4 ----------
python_5 = GhPythonScript(LINE_IN=python.LINE_OUT)  # -> POINT_RENDERED, LINE_RENDERED, MESH_RENDERED; inputs POINT_IN: list, LINE_IN: list, MESH_IN: list; same code as python_4
python_6 = GhPythonScript(MESH_IN=python.MESH_OUT)  # -> POINT_RENDERED, LINE_RENDERED, MESH_RENDERED; inputs POINT_IN: list, LINE_IN: list, MESH_IN: list; same code as python_4
panel = Panel(python_2)
python_7 = GhPythonScript(MESH_IN=python.MESH_OUT, HEIGHT=Slider(3, range=0..10))  # -> out, dev, a, b; inputs MESH_IN: list
# ---------- python_7: Python ----------
from mesh_contour import line_plane_intersection

reload(line_plane_intersection)
lp = line_plane_intersection.LinePlaneIntersection()


########################################

ghenv.Component.Message = 'TEST'



h = float(HEIGHT)
mesh_in = MESH_IN
#print(mesh_in)

mesh_0 = mesh_in[0]
#print(mesh_0)

#line_0 = [mesh_0[0], mesh_0[1]]
#line_0 = [mesh_0[0], mesh_0[2]]
line_0 = [mesh_0[2], mesh_0[0]]
#line_0 = [mesh_0[1], mesh_0[2]]

#print(line_0)

#r = lp.calc_line_plane_intersection(line_0, h)
#r = lp.calc_mesh_plane_intersection(mesh_0, h)
r = lp.calc_meshes_plane_intersection(mesh_in, h)

#a = [r[0], r[1], r[1]]
#a = r
b = r
#dev = r
print(b)
# ---------- end python_7 ----------
python_8 = GhPythonScript(MESH_IN=python_3.a)  # -> POINT_RENDERED, LINE_RENDERED, MESH_RENDERED; inputs MESH_IN: list; same code as python_4
python_9 = GhPythonScript(MESH_IN=python_3.b)  # -> POINT_RENDERED, LINE_RENDERED, MESH_RENDERED; inputs MESH_IN: list; same code as python_4
python_10 = GhPythonScript(LINE_IN=python_3.c)  # -> POINT_RENDERED, LINE_RENDERED, MESH_RENDERED; inputs MESH_IN: list; same code as python_4
panel_2 = Panel("""0
1
2
3""")
facen = FaceNormals(Mesh=python_6.MESH_RENDERED)  # -> Centers, Normals
vdis = VectorDisplay(Anchor=facen.Centers, Vector=facen.Normals)
tag = TextTag3D(Location=python_4.POINT_RENDERED, Text=panel_2, Size=1, Justification=7)
preview = CustomPreview(
    Geometry=python_10.LINE_RENDERED,
    Material={diffuse=RGB(221, 160, 221), emission=RGB(66, 48, 66), shine=0.5, specular=RGB(255, 255, 255), transparency=0})
python_11 = GhPythonScript(POINT_IN=python_7.a)  # -> POINT_RENDERED, LINE_RENDERED, MESH_RENDERED; inputs MESH_IN: list; same code as python_4
python_12 = GhPythonScript(LINE_IN=python_7.b)  # -> POINT_RENDERED, LINE_RENDERED, MESH_RENDERED; inputs LINE_IN: list, MESH_IN: list; same code as python_4
